# Dynamo graph Tag Automático.dyn (Dynamo 2.1.0.7500)

# group: Para Seleção Manual
select_model_elements = DSModelElementsSelection()  # 68 picked in the model

# group: Selecionar Elementos Automaticamente (Escolher Família)
family_types = FamilyTypes("Placa de Base:CH. 16 250x200mm")
all_elements_of_family_type = ElementsOfFamilyType(Family_Type=family_types)

getLocation = Element.GetLocation(element=all_elements_of_family_type)
Y = Point.Y(point=getLocation)
X = Point.X(point=getLocation)
list_create = List.Create(item0=all_elements_of_family_type, item1=Y, item2=X)
transpose = List.Transpose(lists=list_create)
code_block = CodeBlock { 1; }
getItemAtIndex = List.GetItemAtIndex(list=transpose, index=code_block, lacing=Longest)
sortByKey = List.SortByKey(list=transpose, keys=getItemAtIndex)
reverse = List.Reverse(list=sortByKey.sorted_list)
code_block_2 = CodeBlock { 1; }
getItemAtIndex_2 = List.GetItemAtIndex(list=reverse, index=code_block_2, lacing=Longest)
groupByKey = List.GroupByKey(list=reverse, keys=getItemAtIndex_2)
code_block_3 = CodeBlock { 2; }
getItemAtIndex_3 = List.GetItemAtIndex(index=code_block_3)  # unwired: list
map = List.Map(f_x=getItemAtIndex_3)  # unwired: list
map_2 = List.Map(list=groupByKey.groups, f_x=map)
sortByKey_2 = List.SortByKey(list=groupByKey.groups, keys=map_2, lacing=Longest)
code_block_4 = CodeBlock { 1; }
flatten = List.Flatten(list=sortByKey_2.sorted_list, amt=code_block_4)
firstItem = List.FirstItem(list=flatten, lacing=Longest)
code_block_5 = CodeBlock { "Marca"; }
code_block_6 = CodeBlock { "B"; }
count = List.Count(list=firstItem)
code_block_7 = CodeBlock(x=count) { 1..x; }
string_from_object = FromObject(obj=code_block_7)
code_block_8 = CodeBlock(a=code_block_6, b=string_from_object) { a+b; }
setParameterByName = Element.SetParameterByName(element=firstItem, parameterName=code_block_5, value=code_block_8)
